# Dynamo graph NBS-AddValue-Parameters.dyn (Dynamo 2.13.1.3887)
# packages: Data-Shapes 2023.2.111, archi-lab.net 2023.213.1722, Clockwork for Dynamo 2.x 2.6.0

code_block = CodeBlock { "Select Category"; }
getAll = archilab.Revit.Elements.Categories.GetAll()
code_block_2 = CodeBlock(x=getAll.Model) { x; }
all_elements_of_category = ElementsOfCategory(Category=code_block_2)
dropdown_data = Custom[DropDown Data](InputName=code_block, Keys=code_block_2, Values=all_elements_of_category)  # package Data-Shapes; Create data for DropDown input in UI.MultiInputForm ++ . Check out www.data-shapes.net for more infos.
code_block_3 = CodeBlock { "Select Parameter"; }
code_block_4 = CodeBlock()
# ---------- code_block_4.designscript (10 lines) ----------
//Keys
["Material",
"NominalHeight",
"NominalLength","NominalWidth"];


//Values
["Material",
"Height",
"Length","Width"];
# ----------------------------------------
listview_data = Custom[Listview Data](InputName=code_block_3, Keys=code_block_4.out0, Values=code_block_4.out1)  # package Data-Shapes; Create data for ListView input in UI.MultiInputForm ++ . Check out www.data-shapes.net for more infos.
list_create = List.Create(item0=dropdown_data, item1=listview_data)
flatten = List.Flatten(list=list_create)
boolean = BoolSelector(true)
multipleinputform = Custom[MultipleInputForm ++](Inputs=flatten, Toggle=boolean)  # package Data-Shapes; Create a form with multiple inputs. see www.data-shapes.net for tutorials and infos!
code_block_5 = CodeBlock(x=multipleinputform.User_Inputs) { x[0]; x[1]; }
type = archilab.Revit.Elements.Elements.Type(element=code_block_5.out0)
uniqueItems = List.UniqueItems(list=type)
compoundStructureLayers = Custom[FamilyType.CompoundStructureLayers](elementType=uniqueItems)  # package Clockwork for Dynamo 2.x; Retrieves the compound layers of any layered family type (wall types, roof types, floor types etc.)
filterByBoolMask = List.FilterByBoolMask(list=compoundStructureLayers.materials, mask=compoundStructureLayers.isCore)
name = Element.Name(element=filterByBoolMask.in)
setParameterByName = Element.SetParameterByName(element=uniqueItems, parameterName=code_block_5.out1, value=name, lacing=Longest)
getParameterValueByName = Element.GetParameterValueByName(element=uniqueItems, parameterName=code_block_5.out1, lacing=CrossProduct)
setParameterByName_2 = Element.SetParameterByName(element=uniqueItems, parameterName=code_block_4.out0, value=getParameterValueByName, lacing=Longest)
