# Dynamo graph NBS-AddValue-Parameters_new.dyn (Dynamo 2.13.1.3887)
# packages: Data-Shapes 2023.2.111, archi-lab.net 2023.213.1722

file_path = Filename("..\uniclass-all-2023-07\Uniclass2015NBS_Database\Uniclass2015_NBS_Database.xlsx")
file_from_path = FileObject(path=file_path)
code_block = CodeBlock { "Select Category"; }
getAll = archilab.Revit.Elements.Categories.GetAll()
code_block_2 = CodeBlock(x=getAll.Model) { x; }
all_elements_of_category = ElementsOfCategory(Category=code_block_2)
listview_data = Custom[Listview Data](InputName=code_block, Keys=code_block_2, Values=all_elements_of_category)  # package Data-Shapes; Create data for ListView input in UI.MultiInputForm ++ . Check out www.data-shapes.net for more infos.
code_block_3 = CodeBlock { "Select Uniclass"; }
code_block_4 = CodeBlock()
# ---------- code_block_4.designscript (36 lines) ----------
//Keys
[
"Activities",
"Complexes",
"Elements / Functions",
"Entities",
"Form of Information",
"Materials",
"Properties & Characteristics",
"Project Management",
"Products",
"Roles",
"Spaces / Locations",
"Systems",
"Tools & Equipment",
"CAD"
];


//Values
[
"Ac",
"Co",
"Ef",
"En",
"Fi",
"Ma",
"Pc",
"Pm",
"Pr",
"Ro",
"Sl",
"Ss",
"Te",
"Zz"
];
# ----------------------------------------
dropdown_data = Custom[DropDown Data](InputName=code_block_3, Keys=code_block_4.out0, Values=code_block_4.out1)  # package Data-Shapes; Create data for DropDown input in UI.MultiInputForm ++ . Check out www.data-shapes.net for more infos.
list_create = List.Create(item0=listview_data, item1=dropdown_data)
flatten = List.Flatten(list=list_create)
boolean = BoolSelector(true)
multipleinputform = Custom[MultipleInputForm ++](Inputs=flatten, Toggle=boolean)  # package Data-Shapes; Create a form with multiple inputs. see www.data-shapes.net for tutorials and infos!
code_block_5 = CodeBlock { 1; }
getItemAtIndex = List.GetItemAtIndex(list=multipleinputform.User_Inputs, index=code_block_5)
boolean_2 = BoolSelector(false)
importExcel = Data.ImportExcel(file=file_from_path, sheetName=getItemAtIndex, readAsStrings=boolean_2)
code_block_6 = CodeBlock { "n/a"; }
replaceNull = archilab.Lists.Lists.ReplaceNull(list=importExcel@L2, replacement=code_block_6)
code_block_7 = CodeBlock { 0; }
getItemAtIndex_2 = List.GetItemAtIndex(list=multipleinputform.User_Inputs, index=code_block_7)
flatten_2 = List.Flatten(list=getItemAtIndex_2)
type = archilab.Revit.Elements.Elements.Type(element=flatten_2)
uniqueItems = List.UniqueItems(list=type)
code_block_8 = CodeBlock { "Description"; }
getParameterValueByName = Element.GetParameterValueByName(element=uniqueItems, parameterName=code_block_8)
code_block_9 = CodeBlock { 6; }
getItemAtIndex_3 = List.GetItemAtIndex(list=replaceNull@L2, index=code_block_9)
contains = List.Contains(list=getParameterValueByName, item=getItemAtIndex_3, lacing=CrossProduct)
boolean_3 = BoolSelector(true)
allIndicesOf = List.AllIndicesOf(list=contains@L2, item=boolean_3)
getItemAtIndex_4 = List.GetItemAtIndex(list=replaceNull, index=allIndicesOf)

# group: Replace empty
code_block_10 = CodeBlock { "n/a"; }
isEmpty = List.IsEmpty(list=getItemAtIndex_4@L3)
code_block_11 = CodeBlock { false; }
allIndicesOf_2 = List.AllIndicesOf(list=isEmpty, item=code_block_11)
getItemAtIndex_5 = List.GetItemAtIndex(list=getItemAtIndex_4, index=allIndicesOf_2)
code_block_12 = CodeBlock { 0; }
getItemAtIndex_6 = List.GetItemAtIndex(list=getItemAtIndex_5, index=code_block_12)
count = List.Count(list=getItemAtIndex_6@L2)
cycle = List.Cycle(list=code_block_10, amount=count)
code_block_13 = CodeBlock { true; }
allIndicesOf_3 = List.AllIndicesOf(list=isEmpty, item=code_block_13)

python_script = Python(IN[0]=getItemAtIndex_4, IN[1]=cycle)  # CPython3
# ---------- python_script.python (11 lines) ----------
list = IN[0]
replace = IN[1]
out = []

for l in list:
	if l == []:
		out.append(replace)
	else:
		out.append(l)
#Assign your output to the OUT variable.
OUT = out
# ----------------------------------------
code_block_14 = CodeBlock { 9; }
list_getitematindex_nrm = List.GetItemAtIndex(list=python_script@L2, index=code_block_14)
code_block_15 = CodeBlock { "Uniclass2015Code"; }
code_block_16 = CodeBlock { 0; }
list_getitematindex_uniclass = List.GetItemAtIndex(list=python_script@L2, index=code_block_16)  # "List.GetItemAtIndex (Uniclass Code)"
setParameterByName = Element.SetParameterByName(element=uniqueItems, parameterName=code_block_15, value=list_getitematindex_uniclass)
code_block_17 = CodeBlock { "NBSDescription"; "Uniclass2015Title"; }
code_block_18 = CodeBlock { 6; }
list_getitematindex_description = List.GetItemAtIndex(list=python_script@L2, index=code_block_18)
setParameterByName_2 = Element.SetParameterByName(element=uniqueItems, parameterName=code_block_17.out0, value=list_getitematindex_description)
setParameterByName_3 = Element.SetParameterByName(element=uniqueItems, parameterName=code_block_17.out1, value=list_getitematindex_description)
code_block_19 = CodeBlock { "NBSReference"; }
code_block_20 = CodeBlock { 7; }
list_getitematindex_nbs_code = List.GetItemAtIndex(list=python_script@L2, index=code_block_20)
setParameterByName_4 = Element.SetParameterByName(element=uniqueItems, parameterName=code_block_19, value=list_getitematindex_nbs_code)
code_block_21 = CodeBlock { "Category"; }
code_block_22 = CodeBlock { 8; }
list_getitematindex_cobie = List.GetItemAtIndex(list=python_script@L2, index=code_block_22)  # "List.GetItemAtIndex (Cobie Category)"
setParameterByName_5 = Element.SetParameterByName(element=uniqueItems, parameterName=code_block_21, value=list_getitematindex_cobie)
countTrue = List.CountTrue(list=contains)
