# Dynamo graph NBS-Infographics.dyn (Dynamo 2.13.1.3887)
# packages: Data-Shapes 2023.2.111

boolean = BoolSelector(true)
multipleinputform = Custom[MultipleInputForm ++](Toggle=boolean)  # package Data-Shapes; Create a form with multiple inputs. see www.data-shapes.net for tutorials and infos!; unwired: Inputs
code_block = CodeBlock { "A"; }
code_block_2 = CodeBlock { ["Azxc", "Bcxz", "Cdsa"]; }
code_block_3 = CodeBlock { [42, 12, 153]; }
barChart = Custom[BarChart](Series_names=code_block, X_values=code_block_2, Y_values=code_block_3)  # package Data-Shapes; BarChart
multilinetextbox_data = Custom[MultiLineTextBox Data]()  # package Data-Shapes; Creates a multi line textbox input for UI.MultipleInputForm ++
string = StringInput("dsa")
code_block_4 = CodeBlock { ["Azxc", "Bcxz", "Cdsa"]; }
boolean_2 = BoolSelector(true)
multipleinputform_2 = Custom[MultipleInputForm ++](Toggle=boolean_2)  # unwired: Inputs
categories = Categories("OST_Walls")  # graph input
