# Dynamo graph NBS_PieChart.dyn (Dynamo 2.13.1.3887)
# packages: Data-Shapes 2023.2.111, archi-lab.net 2023.213.1722

code_block = CodeBlock { "NBS-Prototype Pie Chart"; }
code_block_2 = CodeBlock { "Select Category"; }
getAll = archilab.Revit.Elements.Categories.GetAll()
code_block_3 = CodeBlock(x=getAll.Model) { x; }
all_elements_of_category = ElementsOfCategory(Category=code_block_3)
dropdown_data = Custom[DropDown Data](InputName=code_block_2, Keys=code_block_3, Values=all_elements_of_category)  # package Data-Shapes; Create data for DropDown input in UI.MultiInputForm ++ . Check out www.data-shapes.net for more infos.
code_block_4 = CodeBlock { "Select Parameter"; }
code_block_5 = CodeBlock { ["Uniclass2015Code","OmniClassCode","Keynote"]; }
dropdown_data_2 = Custom[DropDown Data](InputName=code_block_4, Keys=code_block_5, Values=code_block_5)
list_create = List.Create(item0=dropdown_data, item1=dropdown_data_2)
flatten = List.Flatten(list=list_create)
boolean = BoolSelector(true)
multipleinputform = Custom[MultipleInputForm ++](Inputs=flatten, Toggle=boolean)  # package Data-Shapes; Create a form with multiple inputs. see www.data-shapes.net for tutorials and infos!
code_block_6 = CodeBlock(x=multipleinputform.User_Inputs) { x[0]; x[1]; }
type = archilab.Revit.Elements.Elements.Type(element=code_block_6.out0)
getParameterValueByName = Element.GetParameterValueByName(element=type, parameterName=code_block_6.out1)
uniqueItems = List.UniqueItems(list=getParameterValueByName)
allIndicesOf = List.AllIndicesOf(list=getParameterValueByName, item=uniqueItems)
count = List.Count(list=allIndicesOf@L2)
pieChart = Custom[PieChart](Chart_name=code_block, series=uniqueItems, values=count)  # package Data-Shapes; PieChart
code_block_7 = CodeBlock { 700; }
multipleinputform_2 = Custom[MultipleInputForm ++](Inputs=pieChart, Toggle=boolean, Width_optional=code_block_7)
getCategory = Element.GetCategory(element=code_block_6.out0)
uniqueItems_2 = List.UniqueItems(list=getCategory)
string_from_object = FromObject(object=uniqueItems_2)
